# Grasshopper definition Hexagonal_Facade.gh (Grasshopper 1.0.7)
# plug-ins: LunchBox

xy_plane = XYPlane(Origin=Point(0, 0, 0))
rectangle = Rectangle(Plane=xy_plane, XSize=Slider(20, range=0..50), YSize=Slider(20, range=0..50), Radius=Slider(2, range=0..10))  # -> Rectangle, Length
unit_z = UnitZ(Factor=Slider(20, range=0..20))
extrude = Extrude(Base=rectangle.Rectangle, Direction=unit_z)

unit_x = UnitX(Factor=Slider(30, range=0..50))
move = Move(Geometry=extrude, Motion=unit_x)  # -> Geometry, Transform
surface = Surface(move.Geometry)

deconstruct_domain² = DeconstructDomain²(Domain=extrude)  # -> UMin, UMax, VMin, VMax
rectangle_2 = Rectangle(Plane=xy_plane, XSize=deconstruct_domain².UMax, YSize=deconstruct_domain².VMax, Radius=0)  # -> Rectangle, Length

surface_points = SurfacePoints(Surface=rectangle_2.Rectangle)  # -> Points, Weights, Greville, UCount, VCount
split_list = SplitList(List=surface_points.Points, Index="2")  # -> ListA, ListB
unit_x_2 = UnitX(Factor=Slider(-24, range=-50..50))
interpolate = Interpolate(Vertices=split_list.ListB, Degree=3, Periodic=False, KnotStyle=1)  # -> Curve, Length, Domain
move_2 = Move(Geometry=interpolate.Curve, Motion=unit_x_2)  # -> Geometry, Transform

hexagon_cells = HexagonCells(Surface=rectangle_2.Rectangle, UDivisions=Slider(70, range=0..300), VDivisions=Slider(90, range=0..300), TParameter=0.25)  # -> HexagonCells, Centers

curve_closest_point = CurveClosestPoint(Point=hexagon_cells.Centers, Curve=move_2.Geometry)  # -> Point, Parameter, Distance
construct_domain = ConstructDomain(DomainStart=Slider(0.4, range=0..1), DomainEnd=Slider(0.7, range=0..1))
bounds = Bounds(Numbers=curve_closest_point.Distance)
remap_numbers = RemapNumbers(Value=curve_closest_point.Distance, Source=bounds, Target=construct_domain)  # -> Mapped, Clipped

scale = Scale(Geometry=hexagon_cells.HexagonCells, Center=hexagon_cells.Centers, Factor=remap_numbers.Mapped)  # -> Geometry, Transform
ruled_surface = RuledSurface(CurveA=hexagon_cells.HexagonCells, CurveB=scale.Geometry)

sort_list = SortList(Keys=curve_closest_point.Distance, ValuesValuesA=scale.Geometry)  # -> Keys, ValuesValuesA
list_length = ListLength(List=sort_list.Keys)
jitter = Jitter(List=sort_list.ValuesValuesA, Jitter=Slider(0.198, range=0..1), Seed=2)  # -> Values, Indices
subtraction = Subtraction(A=list_length, B=Slider(1500, range=0..2000))
panel = Panel(subtraction)
sub_list = SubList(List=jitter.Values, Domain=panel, Wrap=True)  # -> List, Index
boundary_surfaces = BoundarySurfaces(Edges=sub_list.List)

unit_z_2 = UnitZ(Factor=Slider(0.07, range=0..1))
extrude_2 = Extrude(Base=[ruled_surface, boundary_surfaces], Direction=unit_z_2)  # -> flatten(Extrusion)
bounding_box = BoundingBox(Content=extrude_2, Plane=PlaneXY(0, 0, 0), UnionBox=True)  # -> Box, Box_2

deconstruct_domain²_2 = DeconstructDomain²(Domain=surface)  # -> UComponent, VComponent
surface_morph = SurfaceMorph(
    Geometry=extrude_2,
    Reference=bounding_box.Box,
    Surface=surface,
    UDomain=deconstruct_domain²_2.UComponent,
    VDomain=deconstruct_domain²_2.VComponent,
    WDomain=Slider(0.25, range=0..1))  # -> flatten(Geometry)
